# Grasshopper definition export_hops.ghx (Grasshopper 1.0.8)
# plug-ins: Human, Increment

py3 = Python3Script(unload=Button())  # inputs unload: Boolean
# ---------- py3: Python ----------
from compas_rhino import unload_modules

import easyhops
if unload:
    unload_modules("easyhops")
# ---------- end py3 ----------

allow_flip = BooleanToggle(True)
hops = Button()
list = ValueList({"RefSide0": 0, "RefSide1": 1, "RefSide2": 2, "RefSide3": 3}, selected="RefSide1")
increment = Increment(BeginningNumber=0, StepSize=1, currentValue=5, increment=1, oldStart=0)  # -> Output, Item
path = FilePath("C:\Users\kapso\GitHub\coding_architecture_fs26_focus_work\fabrication\02_stencil_w02_friday_03.btlx")
panel = Panel(path)
py3_2 = Python3Script(filepath=path, index=increment.Output, ref_side=list, allow_flip=allow_flip, export=hops)  # -> out, model, geometry, processing_report; inputs filepath: String, index: Int32, ref_side: Int32, export: Boolean
# ---------- py3_2: Python ----------
import os, sys, importlib

from compas.scene import Scene
from compas.geometry import angle_vectors

gh_dir = os.path.dirname(ghenv.Component.OnPingDocument().FilePath)
if gh_dir not in sys.path:
    sys.path.insert(0, gh_dir)

import hops_exporter as he
importlib.reload(he)

repo_root = os.path.dirname(os.path.dirname(gh_dir))
hops_dir = gh_dir + "\\HOPS\\"

scene = Scene()

model = he.load_btlx(filepath)

# get element
element = list(model.elements())[index]
element.name = "Beam_" + str(index)
element.attributes["ref_side_index"] = ref_side

he.override_features(element, allow_flip)
geometry = he.visualize_geometry(element, ghenv=ghenv)
processing_report = he.get_processing_report(element)
 
if export:
    HOPSJob = he.export_hop(element, hops_dir)
# ---------- end py3_2 ----------
panel_2 = Panel(py3_2.out)
panel_3 = Panel(py3_2.processing_report)
py3_3 = Python3Script(unload=Button())  # -> out
# ---------- py3_3: Python ----------
from compas_rhino import unload_modules
import compas_timber

if unload:
    unload_modules("compas_timber")
    print("Succesfully unloaded CT!")
# ---------- end py3_3 ----------
panel_4 = Panel(py3_3)
cluster = Cluster(data=py3_2.geometry)  # -> A, B
py3_4 = Python3Script(model=py3_2.model, viz=Toggle(False))  # -> a, b
# ---------- py3_4: Python ----------
from compas.scene import Scene
from compas_rhino.conversions import line_to_compas
scene = Scene()
debug_scene = Scene()

if viz:
    try:
        for element in model.elements():
            scene.add(element.geometry)
            if element.debug_info:
                for fae in element.debug_info:
                    if isinstance(fae.feature_geometry, list):
                        debug_scene.add(fae.feature_geometry[0])
                    else:
                        debug_scene.add(fae.feature_geometry)
    except Exception as e:
        print(e)
    a = scene.draw()
    b = debug_scene.draw()
# ---------- end py3_4 ----------
edges = BrepEdges(Brep=py3_4.a)  # -> Naked, Interior, NonManifold
preview = CustomPreview(Geometry=py3_4.a, Material=ColourSwatch(SwatchColor=RGBA(158, 150, 108, 184)))
preview_2 = CustomPreview(Geometry=cluster.B, Material=ColourSwatch(SwatchColor=RGBA(158, 150, 108, 184)))
previewlw = CustomPreviewLineweights(Geometry=edges.Interior, Shader=ColourSwatch(SwatchColor=RGBA(0, 0, 0, 184)), Absolute=False)
previewlw_2 = CustomPreviewLineweights(Geometry=cluster.A, Shader=ColourSwatch(SwatchColor=RGBA(255, 0, 0, 184)), Absolute=False)

# ==== cluster Cluster
data = ClusterInput()
data_2 = Data(data)
brep = Brep(data_2)
null = NullItem(Item=brep)  # -> NullFlags, InvalidFlags, Description
dispatch = Dispatch(List=data_2, DispatchPattern=null.NullFlags)  # -> ListA, ListB
A = ClusterOutput(dispatch.ListA)
B = ClusterOutput(dispatch.ListB)
